# Dynamo graph Dynword_V2.dyn "Dynword_V2BETA4" (Dynamo 2.6.1.8786)
# packages: Clockwork for Dynamo 1.x 1.0.2, archi-lab.net 2021.25.2621, Genius Loci 2021.6.16

# group: POPUPS
# note: USE:
# Pop ups
# note: ________________________________________________________

# group: SCRIPT DESIGN
# note: ________________________________________________________
# note: USE:
# FOR THE BACK-END FUNCTIONALITY

# group: FROM DYNAMO
# note: ________________________________________________________
# note: USE:
# Export TO Revit (geometry and parameters etc.)

# group: TO DYNAMO
# note: ________________________________________________________
# note: USE:
# Incoming references (File paths, geometry ... )

# group: User Input
# note: ________________________________________________________
# note: USE:
# User input (for eg. sliders, numbers, ....)

# group: MONITOR
# note: USE:
# Stuff you probably want to check
# note: ________________________________________________________

# group: Packages used
# note: Clockwork v.1.0.2
# Rhythm v.2021.6.1
# archilab v.2021.25.2621
# note: ________________________________________________________

# group: TODO
# note: Final letter doesn't 'print' if you win
# Dunno, make forms sexier?
# Add some better graphics?
# note: ________________________________________________________

# group: Instructions for Dynword
# note: How to play
# 1 - Use a TOTALLY BLANK Revit file.
# 2 - Open in Dynamo player.
# 3 - Click run + pick a number from the drop down.
# 4 - Click run + enter an n letter word.
# 5 - Repeat step 3 until game over
# 6 - Click run + the reset button
# 7 - Go to step 3
# note: ________________________________________________________
# note: Points to note
# Current language is English. If you want another language you need to find a URL with your language list + amend the Python clean up node accordingly.
# See 'word - imported' group.

# group: NOTES
# note: Project Name = first go (NOT set as Dynword) / not first go (set as Dynword)
# Project Status = word to guess
# Project Number = which go is it?

# group: Revit project name
code_block = CodeBlock { "Project Information"; }
byName = Category.ByName(name=code_block)
all_elements_of_category = ElementsOfCategory(Category=byName)
code_block_2 = CodeBlock { "Project Name"; }
getParameterValueByName = Element.GetParameterValueByName(element=all_elements_of_category, parameterName=code_block_2, lacing=Longest)

code_block_3 = CodeBlock(ProjectName=getParameterValueByName) { ProjectName != "Dynword" ? 1 : "Dynword"; }

# group: FIRST Popup
code_block_4 = CodeBlock(runme=code_block_3) { runme[0] == 1? true: false; }
# note: Gate to swap between first and other
python_script = Python(IN[0]=code_block_4)
# ---------- python_script.python (120 lines) ----------
import clr
clr.AddReference("System.Windows.Forms")
clr.AddReference("System.Drawing")
import System
from System.Windows.Forms import *
from System.Drawing import *
from System.Net import *
from System.IO import MemoryStream

runme = IN[0]

class CreateWindow(Form):
    def __init__(self):
        self.Name = "Create Window"
        self.Text = "Dynword 2023!©"
        self.Size = Size(360, 250)
        self.CenterToScreen()
                
        label = Label(Text = "Welcome to")
        label.Parent = self
        label.Location = Point(20, 20)
        label.AutoSize = False
        label.Height = 25
        label.Width = 200
        label.ForeColor = Color.Red
        label.Font = Font(label.Font.Name, 16) # set font size to 16
		
		#First image		
        picBox = PictureBox()
        picBox.SizeMode = PictureBoxSizeMode.AutoSize
        picBox.Location = System.Drawing.Point(45, 60)
        
        # Download the image from a URL
        imagePath = r"https://github.com/MoosiestMoose/DY5WORD/blob/main/Dynword2A.JPG?raw=true"
        client = WebClient()
        data = client.DownloadData(imagePath)
        
        # Create a memory stream from the downloaded data
        memoryStream = MemoryStream(data)
        
		# Set the image as the picture box's image
        image = Image.FromStream(memoryStream)
        picBox.Image = image
		
		# Add the picture box to the form
        self.Controls.Add(picBox)  
		
        #Second image
        picBox2 = PictureBox()
        picBox2.SizeMode = PictureBoxSizeMode.AutoSize
        picBox2.Location = System.Drawing.Point(158, 62)
		
        # Download the image from a URL
        imagePath2 = r"https://raw.githubusercontent.com/MoosiestMoose/DY5WORD/69d7bc3c0ac636b6e7c94f375dfbd1468c001888/Dynword2B.JPG"
        client = WebClient()
        data = client.DownloadData(imagePath2)
        
        # Create a memory stream from the downloaded data
        memoryStream2 = MemoryStream(data)
		
        # Set the image as the picture box's image
        image2 = Image.FromStream(memoryStream2)
        picBox2.Image = image2
		
        # Add the picture box to the form
        self.Controls.Add(picBox2)
		
        label = Label(Text = "for Revit")
        label.Parent = self
        label.Location = Point(220, 110)
        label.AutoSize = False
        label.Height = 30
        label.Width = 150
        label.ForeColor = Color.Red
        label.Font = Font(label.Font.Name, 16) # set font size to 16
                        
        button = Button()
        button.Parent = self
        button.Text = "Click me! Click me! Click me! Go on, Click me!"
        button.Location = Point(40, 170)
        button.Width = 255
        button.Click += self.ButtonClicked
        button.BackColor = Color.Green
        button.ForeColor = Color.White     
        
        #drop down
        self.ComboBox = ComboBox()
        self.ComboBox.Parent = self
        self.ComboBox.DropDownStyle = ComboBoxStyle.DropDownList
        self.ComboBox.Items.Add("4")
        self.ComboBox.Items.Add("5")
        self.ComboBox.Items.Add("6")
        self.ComboBox.Items.Add("7")
        self.ComboBox.Location = Point(118, 70)
        self.ComboBox.Width = 35
        self.ComboBox.ItemHeight = 120
        self.ComboBox.Font = Font(self.ComboBox.Font.Name, 10) #Font Size
        self.ComboBox.SelectedIndex = 1 
        
        # Create Bottom Line
        self.bottom_line = Label()
        self.bottom_line.Parent = self
        self.bottom_line.Location = Point(0, 150)
        self.bottom_line.Size = Size(380, 3)
        self.bottom_line.BorderStyle = BorderStyle.FixedSingle
        self.bottom_line.ForeColor = Color.Black
        
        # Make the form always on top
        self.TopMost = True

    def ButtonClicked(self, sender, args):
        if sender.Click:
            self.selected_value = self.ComboBox.SelectedItem
            self.Close()

# Call the form
if runme :
	form = CreateWindow()
	Application.Run(form)
	OUT = "Dynword", int(form.selected_value)
# ----------------------------------------

# group: Client Name (#letters) from Revit Go 1+
code_block_5 = CodeBlock { "Client Name"; }
getParameterValueByName_2 = Element.GetParameterValueByName(element=all_elements_of_category@L1, parameterName=code_block_5)
toNumber = String.ToNumber(str=getParameterValueByName_2)

# group: Number of letters
code_block_6 = CodeBlock(runme=code_block_3, num1=python_script, num2=toNumber) { runme[0] == 1? num1[1]: num2[0]; }

passthrough = Custom[Passthrough](passThrough=code_block_3, waitFor=code_block_6)  # package Clockwork for Dynamo 1.x; Forces a sequential order of execution. The node wired into the output of the Passthrough node will be executed *after* the node wired into the waitFor input (e.g. important for some Revit operations). The value of the passThrough input will be passed on to the node wired into the output port of the Passthrough node.
# note: Gate  -
# if "Dynword" first go
# else other goes
code_block_7 = CodeBlock(OneorDynword=passthrough) { OneorDynword; }

# group: Words import
n15920 = StringInput("https://raw.githubusercontent.com/dwyl/english-words/master/words_alpha.txt")  # "15920"
web_request = WebRequest(url=n15920)
# note: Websites with words
n1500 = StringInput("https://www.mit.edu/~ecprice/wordlist.10000")  # "< 1500"

code_block_8 = CodeBlock(n=code_block_6) { n; }
# note: All possible words
python_script_2 = Python(IN[0]=web_request, IN[1]=code_block_8)
# ---------- python_script_2.python (17 lines) ----------
# Load the Python Standard and DesignScript Libraries
import sys
import clr
clr.AddReference('ProtoGeometry')
from Autodesk.DesignScript.Geometry import *
import random

words = IN[0].split()
n = IN[1]
GameWords = [] 


for i in words:
	if len(i) == n:
		GameWords.append(i.upper())
		
OUT = GameWords
# ----------------------------------------
code_block_9 = CodeBlock(AllWords=python_script_2) { AllWords; }
code_block_10 = CodeBlock(AllWords=code_block_9) { AllWords; }
passthrough_2 = Custom[Passthrough](passThrough=code_block_7, waitFor=code_block_10)

# group: Get current marks
code_block_11 = CodeBlock()
# ---------- code_block_11.designscript (3 lines) ----------
DSCore.Types
.FindTypeByNameInAssembly
("FilledRegion","RevitAPI");
# ----------------------------------------
all_elements_of_type = ElementsOfType(element_type=code_block_11)
code_block_12 = CodeBlock { "Mark"; }
getParameterValueByName_3 = Element.GetParameterValueByName(element=all_elements_of_type, parameterName=code_block_12, lacing=Longest)

# group: Seperate keyboard filled regions
code_block_13 = CodeBlock { ""; }
eq = getParameterValueByName_3 == code_block_13
filterByBoolMask = List.FilterByBoolMask(list=getParameterValueByName_3, mask=eq)
# note: in = keyboard
# out = guesses
uniqueItems = List.UniqueItems(list=filterByBoolMask.out)
filterByBoolMask_2 = List.FilterByBoolMask(list=all_elements_of_type, mask=eq)

code_block_14 = CodeBlock(n=code_block_8) { n; }

# group: Popup 2
# note: IN
# [0 Run me
# [1] Previous guesses
# [2] All possible words
# [3] length of word
# note: OUT
# RESET - for resetting
# A letter when playing for a game
python_script_3 = Python(IN[0]=passthrough_2, IN[1]=uniqueItems, IN[2]=code_block_10, IN[3]=code_block_14)
# ---------- python_script_3.python (115 lines) ----------
import clr
clr.AddReference("System.Windows.Forms")
clr.AddReference("System.Drawing")
import System
from System.Windows.Forms import *
from System.Drawing import *

Runme = IN[0]
Previous_guesses = IN[1]
AllWords = IN[2]
n = IN[3]
if n == 4 : 
	n_str = "four"
elif n == 5:
	n_str = "five"
elif n == 6:
	n_str = "six"
elif n == 7:
	n_str = "seven"

class CreateWindow(Form):
	def __init__(self):
			self.Name = "Create Window"
			self.Text = "©Dynword 2023!"
			self.Size = Size(340, 230)
			self.CenterToScreen()
			self.BackColor = Color.Cornsilk
			self.value = None
			        
			label = Label(Text = "Guess a " + n_str + " letter word")
			label.Parent = self
			label.Location = Point(25, 10)
			label.Height = 30
			label.Width = 300
			label.Font = Font("Arial", 14)
			label.ForeColor = Color.DarkSlateBlue
			
			self.textbox = TextBox()
			self.textbox.Parent = self
			self.textbox.Text = "moose"
			self.textbox.Location = Point(90, 45)
			self.textbox.Size = Size(140, 40)
			self.textbox.Font = Font("Arial", 18)
			self.textbox.Multiline = True
			self.textbox.CharacterCasing = CharacterCasing.Upper
			
			label = Label(Text = "This box stays open until you enter an unguessed, " + n_str + " letter word that is contained in the wordlist.\nReturn or Enter clears the box")
			label.Parent = self
			label.Location = Point(25, 95)
			label.Height = 45
			label.Width = 280
			label.TextAlign = ContentAlignment.MiddleCenter
			label.Font = Font("Arial", 9)
			label.ForeColor = Color.OliveDrab
			
			self.button1 = Button()
			self.button1.Parent = self
			self.button1.Text = "GUESS WORD"
			self.button1.Font = Font("Arial", 10)
			self.button1.Location = Point(185, 155)
			self.button1.Width = 110
			self.button1.Height = 30
			self.button1.Click += self.ButtonClicked
			self.button1.BackColor = Color.DarkSlateBlue
			self.button1.ForeColor = Color.White
			
			self.button2 = Button()
			self.button2.Parent = self
			self.button2.Text = "NEW GAME"
			self.button2.Font = Font("Arial", 10)
			self.button2.Location = Point(30, 155)
			self.button2.Width = 110
			self.button2.Height = 30
			self.button2.Click += self.ButtonClicked
			self.button2.BackColor = Color.Red
			self.button2.ForeColor = Color.White
				
			# Create Bottom Line
			self.bottom_line = Label()
			self.bottom_line.Parent = self
			self.bottom_line.Location = Point(0, 145)
			self.bottom_line.Size = Size(380, 3)
			self.bottom_line.BorderStyle = BorderStyle.FixedSingle
			self.bottom_line.ForeColor = Color.Black
			
			# Make the form always on top
			self.TopMost = True

	def ButtonClicked(self, sender, args):
		if sender == self.button2: #NEW GAME
			self.value = "RESET"
			self.Close()
		if sender == self.button1: #GUESS WORD
			self.value = self.textbox.Text
			self.Close()
	
# Call the form
if Runme[0] == "Dynword":
	while True:
	    form = CreateWindow()
	    Application.Run(form)
	    if form.value == "RESET":
	    	OUT = form.value
	        break
	    if len(form.value) != n: 
	        continue
	    elif not form.value.isalpha():
	    	continue
	    elif form.value in Previous_guesses:
	        continue
	    elif form.value not in AllWords:
	        continue
	    else:
	        OUT = form.value
	        break
# ----------------------------------------

# group: The Revit active view
current = Document.Current()
activeView = Document.ActiveView(document=current)

code_block_15 = CodeBlock(ActiveView=activeView) { ActiveView; }
code_block_16 = CodeBlock(Guess=python_script_3, ActiveView=code_block_15) { Guess == "RESET"? "" : ActiveView; }

# group: n * 6 Grid of squares
code_block_17 = CodeBlock(n=code_block_6) { Point.ByCoordinates((0..#n..550)<1>, (0..#6..550)<2>); }
reverse = List.Reverse(list=code_block_17@L2)
python_script_4 = Python(IN[0]=code_block_6)
# ---------- python_script_4.python (12 lines) ----------
#Yes I know this is a bit lame but I originally made it for 5 words only and I cba to rewrite it ... This is an easy option :D 

n = IN[0]

if n == 4:
	OUT = 275
if n == 5:
	OUT = 0
if n == 6:
	OUT = -275
if n == 7:
	OUT = -550
# ----------------------------------------
translate = Geometry.Translate(geometry=reverse@L2, xTranslation=python_script_4)
byOrigin = CoordinateSystem.ByOrigin(origin=translate)
code_block_18 = CodeBlock { 500; }
byWidthLength = Rectangle.ByWidthLength(cs=byOrigin, width=code_block_18, length=code_block_18)
explode = Geometry.Explode(geometry=byWidthLength)

code_block_19 = CodeBlock(ProjectInfo=all_elements_of_category) { ProjectInfo; }
code_block_20 = CodeBlock(ProjectInfo=code_block_19) { ProjectInfo; }

# group: FIRST
# note: OUT = random 5 letter word
# note: Only runs if input is '1'
python_script_5 = Python(IN[0]=passthrough, IN[1]=web_request, IN[2]=code_block_6)
# ---------- python_script_5.python (24 lines) ----------
# Load the Python Standard and DesignScript Libraries
import sys
import clr
clr.AddReference('ProtoGeometry')
from Autodesk.DesignScript.Geometry import *
import random

n = IN[2]
	
if IN[0][0] == 1:


	words = IN[1].split()
	
	
	GameWords = [] 
	
	for i in words:
	    if len(i) == n:
	        GameWords.append(i)
	        
	GameWord = random.choice(GameWords)
	
	OUT = GameWord.upper()
# ----------------------------------------

# group: FIRST -Project Status + Project Number
code_block_21 = CodeBlock { ["Project Status", "Project Number"]; }
code_block_22 = CodeBlock(NEW=passthrough, name=code_block_21) { NEW == 1 ? [name] : ""; }
code_block_23 = CodeBlock(status=python_script_5) { [status, "0"]; }
setParameterByName = Element.SetParameterByName(element=code_block_20, parameterName=code_block_22@L1, value=code_block_23@L1)

# group: Project Status and Number from Revit
code_block_24 = CodeBlock { ["Project Status", "Project Number"]; }
passthrough_3 = Custom[Passthrough](passThrough=code_block_24, waitFor=setParameterByName)
getParameterValueByName_4 = Element.GetParameterValueByName(element=code_block_20@L1, parameterName=passthrough_3)

code_block_25 = CodeBlock(i=getParameterValueByName_4) { i[0][1]; }

# group: Turn #
toNumber_2 = String.ToNumber(str=code_block_25)
# note: 0 - do nothing
# 1 - firstline
# 2 - second line
# 3
# 4
# 5
# 6
# END
code_block_26 = CodeBlock(GO=toNumber_2) { GO == 0 ? "" : GO -1; }

getItemAtIndex = List.GetItemAtIndex(list=explode@L3, index=code_block_26)

# group: To Revit - filled regions
# note: Filled region type
python_script_6 = Python()  # unwired: IN[0]
# ---------- python_script_6.python (18 lines) ----------
import clr
clr.AddReference("RevitAPI")
from Autodesk.Revit.DB import *
clr.AddReference("RevitServices")
import RevitServices
from RevitServices.Persistence import DocumentManager

doc = DocumentManager.Instance.CurrentDBDocument
type_name = []

filled_region_types = FilteredElementCollector(doc).OfClass(FilledRegionType).ToElements()

for filled_region_type in filled_region_types:
    type_name_param = filled_region_type.get_Parameter(BuiltInParameter.SYMBOL_NAME_PARAM)
    type_name.append(type_name_param.AsString())
    OUT = filled_region_type

#OUT = (type_name)
# ----------------------------------------
# note: Word boxes filled region in Revit
byCurves = FilledRegion.ByCurves(view=code_block_16, boundary=getItemAtIndex, regionType=python_script_6)

code_block_27 = CodeBlock(Guess=python_script_3) { Guess; }
WORD = CodeBlock(i=getParameterValueByName_4) { i[0][0]; }
code_block_28 = CodeBlock(word=WORD) { word; }

# group: Current guess
# note: IN
# [0] Guess
# [1] Word
python_script_7 = Python(IN[0]=code_block_27, IN[1]=code_block_28)
# ---------- python_script_7.python (46 lines) ----------
import clr
clr.AddReference('DSCoreNodes')
import DSCore

Guess = IN[0]
Word = IN[1]
green = DSCore.Color.ByARGB(255, 0, 128, 0)
yellow = DSCore.Color.ByARGB(255, 255, 255, 0)
grey = DSCore.Color.ByARGB(255, 128, 128, 128)
numbers4colours = []
used_letters = ""
letter_counts = {}
output = []

if Guess == "RESET":
	OUT = ""
else:
	# Count the number of occurrences of each letter in Word
	for letter in Word:
	    if letter not in letter_counts:
	        letter_counts[letter] = 1
	    else:
	        letter_counts[letter] += 1
	
	# Compare Guess with Word
	for index, letter in enumerate(Guess):
	    if letter == Word[index]:
	        numbers4colours.append(2)
	        letter_counts[letter] -= 1
	    else:
	        numbers4colours.append(0)
	        
	for index, letter in enumerate(Guess):
	    if numbers4colours[index] == 0 and letter in letter_counts and letter_counts[letter] > 0:
	        numbers4colours[index] = 1
	        letter_counts[letter] -= 1
	
	for num in numbers4colours:
	    if num == 2:
	        output.append(green)
	    elif num == 1: 
	        output.append(yellow)
	    else:
	        output.append(grey)
	
	OUT = output , numbers4colours
# ----------------------------------------
# note: Compare guess with word.
# Green - correct letter correct place
# Yellow -  correct letter wrong place
# Gray - letter not in word
code_block_29 = CodeBlock(i=python_script_7) { i[0]; }
overrideColorInView = Element.OverrideColorInView(element=byCurves, color=code_block_29)

# group: Set project name to, "Dynword" + client name to #letters
code_block_30 = CodeBlock { ["Project Name", "Client Name"]; }
code_block_31 = CodeBlock(NEW=passthrough, name=code_block_30) { NEW == 1 ? [name] : ""; }
string_from_object = FromObject(obj=python_script)
setParameterByName_2 = Element.SetParameterByName(element=code_block_19, parameterName=code_block_31@L1, value=string_from_object@L1)

code_block_32 = CodeBlock(NEW=passthrough, view=activeView) { NEW == 1 ? view : ""; }

# group: FIRST go - guess square outlines
# note: All guess square outlines in Revit
byCurve = DetailCurve.ByCurve(view=code_block_32, curve=explode@L1)

code_block_33 = CodeBlock(ProjectInfo=code_block_20) { ProjectInfo; }
code_block_34 = CodeBlock(ProjectInfo=code_block_33) { ProjectInfo; }
code_block_35 = CodeBlock(reset=python_script_3) { reset; }

# group: Set project number
toNumber_3 = String.ToNumber(str=code_block_25)
code_block_36 = CodeBlock(A=toNumber_3) { A + 1; }
string_from_object_2 = FromObject(obj=code_block_36)
code_block_37 = CodeBlock(input=code_block_35, go=string_from_object_2) { "Project Number"; input == "RESET"? "0" : go; }
setParameterByName_3 = Element.SetParameterByName(element=code_block_34, parameterName=code_block_37.out0, value=code_block_37.out1)

code_block_38 = CodeBlock(ActiveView=code_block_15) { ActiveView; }

# group: Placement points for words
getItemAtIndex_2 = List.GetItemAtIndex(list=translate@L2, index=code_block_26)
X = Point.X(point=getItemAtIndex_2)
Y = Point.Y(point=getItemAtIndex_2)
code_block_39 = CodeBlock(Y=Y) { Y + 200; }
byCoordinates = Point.ByCoordinates(x=X, y=code_block_39)

code_block_40 = CodeBlock(Guess=python_script_3) { Guess; }
# note: Guess as a list
python_script_8 = Python(IN[0]=code_block_40)
# ---------- python_script_8.python (7 lines) ----------
OUT = []

if IN[0] == "RESET":
	OUT = ""
else: 
	for i in IN[0]:
		OUT.append(i)
# ----------------------------------------

# group: Text in Revit
code_block_41 = CodeBlock { "Center"; }
byLocation = TextNote.ByLocation(view=code_block_38, location=byCoordinates, text=python_script_8, alignment=code_block_41)
type = archilab.Revit.Elements.Elements.Type(element=byLocation)
code_block_42 = CodeBlock { ["Text Font" ,"Background", "Text Size"]; }
code_block_43 = CodeBlock { ["Arial", 1, 2.5]; }
setParameterByName_4 = Element.SetParameterByName(element=type, parameterName=code_block_42, value=code_block_43)

# group: FINAL Popup Win
code_block_44 = CodeBlock(i=python_script_7) { i[1]; }
sum = Math.Sum(values=code_block_44)
code_block_45 = CodeBlock { true; false; }
code_block_46 = CodeBlock(word=code_block_28, sum=sum, win=code_block_45.out0, continues=code_block_45.out1) { word; sum == 10? win : continues; }
python_script_9 = Python(IN[0]=code_block_46.word, IN[1]=code_block_46.out1)
# ---------- python_script_9.python (67 lines) ----------
import clr
clr.AddReference("System.Windows.Forms")
clr.AddReference("System.Drawing")
import System
from System.Windows.Forms import *
from System.Drawing import *
from System.Net import *
from System.IO import MemoryStream

word = IN[0]
RunMe = IN[1]

class CreateWindow(Form):
	def __init__(self):
			self.Name = "Create Window"
			self.Text = "Dynword 2023!©"
			self.Size = Size(360, 250)
			self.CenterToScreen()
			        
			label = Label(Text = "WINNER!\nThe word was:")
			label.Parent = self
			label.Location = Point(10, 20)
			label.AutoSize = False
			label.Height = 50
			label.Width = 340
			label.ForeColor = Color.DarkSlateGray
			label.Font = Font(label.Font.Name, 16) 
			label.TextAlign = ContentAlignment.MiddleCenter
						
			picBox = PictureBox()
			picBox.SizeMode = PictureBoxSizeMode.AutoSize
			picBox.Location = System.Drawing.Point(40, 60)

			label = Label(Text =  word + "  ッ")
			label.Parent = self
			label.Location = Point(10, 80)
			label.AutoSize = False
			label.Height = 50
			label.Width = 340
			label.ForeColor = Color.Red
			label.Font = Font(label.Font.Name, 18) 
			label.TextAlign = ContentAlignment.MiddleCenter
								
			button = Button()
			button.Parent = self
			button.Text = "Close window, click run + 'New Game' on the next pop up"
			button.Font = Font(button.Font.Name, 10)
			button.Location = Point(45, 150)
			button.Width = 255
			button.Height = 50
			button.Click += self.ButtonClicked
			button.BackColor = Color.DarkSlateGray
			button.ForeColor = Color.White     

			# Make the form always on top
			self.TopMost = True

	def ButtonClicked(self, sender, args):
		if sender.Click:
			self.value = "RESET"
			self.Close()

# Call the form
if RunMe:
	form = CreateWindow()
	Application.Run(form)
	OUT = form.value
# ----------------------------------------

code_block_47 = CodeBlock(NewFilledRegions=byCurves) { NewFilledRegions; }

# group: Set mark to guess
code_block_48 = CodeBlock(Guess=code_block_27) { Guess == "RESET"? "" : "Mark"; }
passthrough_4 = Custom[Passthrough](passThrough=code_block_48, waitFor=uniqueItems)
setParameterByName_5 = Element.SetParameterByName(element=code_block_47, parameterName=passthrough_4, value=code_block_27)

code_block_49 = CodeBlock(Go=toNumber_2) { Go; }

# group: FINAL Popup Loose
code_block_50 = CodeBlock { true; false; }
code_block_51 = CodeBlock(word=code_block_28, sum=code_block_49, winsum=sum, loose=code_block_50.out0, continues=code_block_50.out1) { word; sum == 6 && winsum !=10 ? loose : continues; }
python_script_10 = Python(IN[0]=code_block_51.word, IN[1]=code_block_51.out1)
# ---------- python_script_10.python (68 lines) ----------
import clr
clr.AddReference("System.Windows.Forms")
clr.AddReference("System.Drawing")
import System
from System.Windows.Forms import *
from System.Drawing import *
from System.Net import *
from System.IO import MemoryStream

word = IN[0]
RunMe = IN[1]

class CreateWindow(Form):
	def __init__(self):
			self.Name = "Create Window"
			self.Text = "Dynword 2023!©"
			self.Size = Size(360, 250)
			self.CenterToScreen()
			        
			label = Label(Text = "Sorry you loose!\nThe word was:")
			label.Parent = self
			label.Location = Point(10, 20)
			label.AutoSize = False
			label.Height = 50
			label.Width = 340
			label.ForeColor = Color.DarkSlateGray
			label.Font = Font(label.Font.Name, 16) 
			label.TextAlign = ContentAlignment.MiddleCenter
						
			picBox = PictureBox()
			picBox.SizeMode = PictureBoxSizeMode.AutoSize
			picBox.Location = System.Drawing.Point(40, 60)

			label = Label(Text =  word + "  ッ")
			label.Parent = self
			label.Location = Point(10, 80)
			label.AutoSize = False
			label.Height = 50
			label.Width = 340
			label.ForeColor = Color.Red
			label.Font = Font(label.Font.Name, 18) 
			label.TextAlign = ContentAlignment.MiddleCenter
								
			button = Button()
			button.Parent = self
			button.Text = " self"
			button.Text = "Close window, click run + 'New Game' on the next pop up"
			button.Font = Font(button.Font.Name, 10)
			button.Location = Point(45, 150)
			button.Width = 255
			button.Height = 50
			button.Click += self.ButtonClicked
			button.BackColor = Color.DarkSlateGray
			button.ForeColor = Color.White     

			# Make the form always on top
			self.TopMost = True

	def ButtonClicked(self, sender, args):
		if sender.Click:
			self.value = "RESET"
			self.Close()

# Call the form
if RunMe:
	form = CreateWindow()
	Application.Run(form)
	OUT = form.value
# ----------------------------------------

# group: reset project name, number and status
code_block_52 = CodeBlock(input=code_block_35) { input == "RESET"? ["Project Name", "Project Number", "Project Status"]: ""; " "; }
setParameterByName_6 = Element.SetParameterByName(element=code_block_34, parameterName=code_block_52.out0, value=code_block_52.out1, lacing=Longest)

# group: Filled region, lines + text notes from Revit
code_block_53 = CodeBlock { ["Text Notes" , "Lines" ]; }
code_block_54 = CodeBlock(input=code_block_35, itemnames=code_block_53) { input == "RESET"? itemnames : ""; }
byName_2 = Category.ByName(name=code_block_54)
all_elements_of_category_2 = ElementsOfCategory(Category=byName_2)

# group: Get filled regions
code_block_55 = CodeBlock { "FilledRegion"; }
code_block_56 = CodeBlock(input=code_block_35, itemnames=code_block_55) { input == "RESET"? itemnames : ""; }
code_block_57 = CodeBlock(ElementName=code_block_56)
# ---------- code_block_57.designscript (3 lines) ----------
DSCore.Types
.FindTypeByNameInAssembly
(ElementName,"RevitAPI");
# ----------------------------------------
all_elements_of_type_2 = ElementsOfType(element_type=code_block_57)

# group: Delete filled region + text notes- reset game
code_block_58 = CodeBlock(stuff=all_elements_of_category_2, FR=all_elements_of_type_2) { [stuff , FR]; }
delete = Element.Delete(element=code_block_58)

code_block_59 = CodeBlock { true; }
code_block_60 = CodeBlock(Keyboard=filterByBoolMask_2.in) { Keyboard; }
code_block_61 = CodeBlock(Keyboard=code_block_60) { Keyboard; }
code_block_62 = CodeBlock(Keyboard=code_block_61) { Keyboard; }
code_block_63 = CodeBlock(ActiveView=code_block_38) { ActiveView; }

# group: Keyboard letter rectangles
code_block_64 = CodeBlock()
# ---------- code_block_64.designscript (26 lines) ----------
[Point.ByCoordinates(-1150.000, -800.000),
  Point.ByCoordinates(-650.000, -800.000),
  Point.ByCoordinates(-150.000, -800.000),
  Point.ByCoordinates(350.000, -800.000),
  Point.ByCoordinates(850.000, -800.000),
  Point.ByCoordinates(1350.000, -800.000),
  Point.ByCoordinates(1850.000, -800.000),
  Point.ByCoordinates(2350.000, -800.000),
  Point.ByCoordinates(2850.000, -800.000),
  Point.ByCoordinates(3350.000, -800.000),
  Point.ByCoordinates(3100.000, -1400.000),
  Point.ByCoordinates(2600.000, -1400.000),
  Point.ByCoordinates(2100.000, -1400.000),
  Point.ByCoordinates(1600.000, -1400.000),
  Point.ByCoordinates(1100.000, -1400.000),
  Point.ByCoordinates(600.000, -1400.000),
  Point.ByCoordinates(100.000, -1400.000),
  Point.ByCoordinates(-400.000, -1400.000),
  Point.ByCoordinates(-900.000, -1400.000),
  Point.ByCoordinates(-400.000, -2000.000),
  Point.ByCoordinates(100.000, -2000.000),
  Point.ByCoordinates(600.000, -2000.000),
  Point.ByCoordinates(1100.000, -2000.000),
  Point.ByCoordinates(1600.000, -2000.000),
  Point.ByCoordinates(2100.000, -2000.000),
  Point.ByCoordinates(2600.000, -2000.000)];
# ----------------------------------------
code_block_65 = CodeBlock { 400; 500; }

code_block_66 = CodeBlock(GO=toNumber_2, points=code_block_64) { GO == 0 ? points : ""; }

# group (continued): Keyboard letter rectangles
X_2 = Point.X(point=code_block_66)
Y_2 = Point.Y(point=code_block_66)
code_block_67 = CodeBlock(Y=Y_2) { Y + 200; }
byCoordinates_2 = Point.ByCoordinates(x=X_2, y=code_block_67)
byOrigin_2 = CoordinateSystem.ByOrigin(origin=code_block_66)
byWidthLength_2 = Rectangle.ByWidthLength(cs=byOrigin_2, width=code_block_65.out0, length=code_block_65.out1)
explode_2 = Geometry.Explode(geometry=byWidthLength_2)

# group: Keyboard display in Revit
code_block_68 = CodeBlock { ["QWERTYUIOPLKJHGFDSAZXCVBNM"]; }
code_block_69 = CodeBlock { ""; }
split = String.Split(str=code_block_68, separator0=code_block_69)
code_block_70 = CodeBlock { "Center"; }
byLocation_2 = TextNote.ByLocation(view=code_block_63, location=byCoordinates_2@L2, text=split@L2, alignment=code_block_70)
type_2 = archilab.Revit.Elements.Elements.Type(element=byLocation_2)
code_block_71 = CodeBlock { ["Text Font" ,"Background", "Text Size"]; }
code_block_72 = CodeBlock { ["Arial", 1, 2.5]; }
setParameterByName_7 = Element.SetParameterByName(element=type_2, parameterName=code_block_71, value=code_block_72)

code_block_73 = CodeBlock(Keyboard_Letters=split) { Keyboard_Letters; }
code_block_74 = CodeBlock(keyboardletters=code_block_73) { keyboardletters[0]; }

# group: Keyboard colours
# note: IN
# [0] Guess
# [1] Guess colours
# [2] Colours + current colours
# [3] Keyboard letters
python_script_11 = Python(IN[0]=code_block_62)
# ---------- python_script_11.python (38 lines) ----------
# Load the Python Standard and DesignScript Libraries
import sys
import clr
clr.AddReference('DSCoreNodes')
import DSCore
from DSCore import Color
clr.AddReference("RevitServices")
import RevitServices
from RevitServices.Persistence import DocumentManager

elements = UnwrapElement(IN[0]) if isinstance(IN[0],list) else [UnwrapElement(IN[0])]
views = DocumentManager.Instance.CurrentDBDocument.ActiveView

green = DSCore.Color.ByARGB(255, 0, 128, 0)
yellow = DSCore.Color.ByARGB(255, 255, 255, 0)
grey = DSCore.Color.ByARGB(255, 128, 128, 128)

output = []

for element in elements :
	override = views.GetElementOverrides(element.Id)
	ForegroundColour = override.SurfaceForegroundPatternColor
	if ForegroundColour.IsValid:
		colour = DSCore.Color.ByARGB(255, ForegroundColour.Red, ForegroundColour.Green, ForegroundColour.Blue)
	

		
		if colour ==  green:
			output.append("green")
		if colour ==  yellow:
			output.append("yellow")	
		if colour ==  grey:
			output.append("grey")			
	else:
		output.append("no")

OUT = [green, yellow, grey], output
		
# ----------------------------------------
python_script_12 = Python(IN[0]=code_block_27, IN[1]=code_block_29, IN[2]=code_block_62, IN[3]=python_script_11, IN[4]=code_block_74)
# ---------- python_script_12.python (59 lines) ----------
Guess = IN[0]
Guess_Colours = IN[1]
RevitElements = IN[2]
green = IN[3][0][0]
yellow = IN[3][0][1]
grey = IN[3][0][2]
CurrentColours = IN[3][1]
keyboardletters = IN[4]

Guess_Dict = {}
keyboard_dict = {}
Revit_Elements = {}
NewColours = []
RevitElem2Change = []
xx = []

if Guess == "RESET":
	OUT = ""
else:
	#create dictionary to match guess and colours of guess
	for index, letter in enumerate (Guess):
		if letter not in Guess_Dict:
			Guess_Dict[letter] = Guess_Colours[index]
		else:
			### NEEED TO COMPARE AND ONLY CHANGE IF HIGHER COLOUR :) #######
			if Guess_Dict[letter] == grey:
				Guess_Dict[letter] = Guess_Colours[index]
			elif Guess_Dict[letter] == yellow:
				if Guess_Colours[index] == green:
					Guess_Dict[letter] = Guess_Colours[index]
			elif Guess_Dict[letter] == green:
				pass
				
	#create dictionary for keyboard letters and colours
	for index, let in enumerate (keyboardletters):
		keyboard_dict[let] = CurrentColours[index]
	
	#create dictionary for keyboard letters and RevitElems
	for index, lets in enumerate (keyboardletters):
		Revit_Elements[lets] = RevitElements[index]
	
	#Check keyboard colour against guess colour - only overwrite no + yellow
	for LETTER in Guess_Dict: 
		if Guess_Dict[LETTER] == grey:
			NewColours.append(grey)
			RevitElem2Change.append(Revit_Elements[LETTER])
		if Guess_Dict[LETTER] == yellow:
			if keyboard_dict[LETTER] != "green":
				NewColours.append(yellow)
				RevitElem2Change.append(Revit_Elements[LETTER])
				xx.append(keyboard_dict[LETTER])
			else: 
				pass
		if Guess_Dict[LETTER] == green:
			NewColours.append(green)
			RevitElem2Change.append(Revit_Elements[LETTER])


OUT = NewColours, RevitElem2Change, xx, green, keyboard_dict["O"]
# ----------------------------------------
# note: OUT
# [1] Filled region corresponding to letter
# [0] Colour of filled region
code_block_75 = CodeBlock(i=python_script_12) { i[1]; i[0]; }
overrideColorInView_2 = Element.OverrideColorInView(element=code_block_75.out0@L1, color=code_block_75.out1@L1)

# group: To Revit - filled regions keyboard
byCurves_2 = FilledRegion.ByCurves(view=code_block_63, boundary=explode_2, regionType=python_script_6)
fill_patterns = FillPatterns()  # nothing selected
color_palette = ColorPalette({R: 230, G: 230, B: 250, A: 255})
code_block_76 = CodeBlock { false; 10; }
filledregion_properties_change = Custom[FilledRegion Properties Change](FilledRegion_OrType=byCurves_2, ForegroundPattern=fill_patterns, ForegroundPatternColor=color_palette, IsMasking=code_block_76.out0, LineWeight=code_block_76.out1)  # package Genius Loci; Assigns Pattern, Color and Line Weight to the given Filled Region or to a Filled Region Type. Note : Prior to Revit 2019, the materials have only one surface pattern and one cut pattern.
